test file "testVCUHV"

suite "新建测试套件 1"

  case "新建测试用例 1" [baseline]
    test data file: testVCUHV.xlsx
    model VCUHVACT, harness VCUHVACT_Harness1 (for VCUHVACT/HVAct_100ms_sys)
    parameter set "testVCUHV.xlsx":
      const = 10.0  % mask workspace, VCUHVACT_Harness1/HVAct_100ms_sys/logic/Compare To Constant
      const = 3.0  % mask workspace, VCUHVACT_Harness1/HVAct_100ms_sys/logic/Compare To Constant1
      const = 0.0  % mask workspace, VCUHVACT_Harness1/HVAct_100ms_sys/logic/Compare To Constant2
      const = 0  % mask workspace, VCUHVACT_Harness1/HVAct_100ms_sys/logic/ElcSub/Compare To Constant
      const = 0  % mask workspace, VCUHVACT_Harness1/HVAct_100ms_sys/logic/ElcSub/Compare To Constant1
      const = 0  % mask workspace, VCUHVACT_Harness1/HVAct_100ms_sys/logic/ElcSub/Compare To Constant2
      const = 1  % mask workspace, VCUHVACT_Harness1/HVAct_100ms_sys/logic/ElcSub/Compare To Constant3
      const = 0  % mask workspace, VCUHVACT_Harness1/HVAct_100ms_sys/logic/ElcSub/Compare To Constant4
      const = 3  % mask workspace, VCUHVACT_Harness1/HVAct_100ms_sys/logic/ElcSub/Compare To Constant5
      const = 1  % mask workspace, VCUHVACT_Harness1/HVAct_100ms_sys/logic/ElcSub/Compare To Constant6
    input "场景1" from testVCUHV.xlsx, mapped to read_AcceleratorPedal_Opening_uint16_t, read_ActualGear_Status_uint8_t, read_BmsBattery_SocValue_float64, read_BmsBatteryTotal_Current_float64, read_BmsMainNegativeRelay_Status_bool, read_BmsMainNegativeRelayClosed_Status_uint8_t, read_BmsRelayOff_Request_uint8_t, read_BrakePedal_Status_uint8_t, read_DcdcWorking_Status_uint8_t, read_FastChargePlug_Status_bool, read_KeyOnSwitch_Signal_bool, read_KeyStartSwitch_Signal_bool, read_McuWorking_Status_uint8_t, read_PduMainPrechargeRelay_Status_uint8_t, read_PduMainRelay_Status_uint8_t, read_SelfCheck_Status_bool, read_SlowChargePlug_Status_bool, read_VehicleFaultLevel_uint8_t, read_VehicleSpeed_Kph_float64 (active)
    baseline "场景1"
      write_BmsFault_Status_unit8_t:1
      write_Dcdc_Enable_uint8_t:1
      write_DcdcFault_Status_uint8_t:1
      write_MainNegativeRelay_Enable_unit8_t:1
      write_MainPrechargeRelay_Enable_uint8_t:1
      write_MainRelay_Enable_uint8_t:1
      write_VehicleReady_Status_uint8_t:1